# Grasshopper definition example01.ghx (Grasshopper 1.0.7)
# plug-ins: Kangaroo2 Components, Anemone

reload = Button()
panel = Panel("1.a) Define planar curve/s")
panel_2 = Panel("1.b) Run simulation")
py = GhPythonScript()  # -> name, WEB, DATA
# ---------- py: Python ----------
import sys
import os

filepath = os.path.dirname(ghenv.Component.OnPingDocument().FilePath)

name = os.path.basename(ghenv.Component.OnPingDocument().FilePath)
name = os.path.splitext(name)[0]

LIB = os.path.join(filepath, "..", "src")
LIB = os.path.abspath(LIB)

sys.path.append(LIB)

from workshop_sjsu import DATA
from workshop_sjsu import WEB
# ---------- end py ----------
panel_3 = Panel("Example 01: Differential growth")
panel_4 = Panel(py.name)
py_2 = PythonScript(reload=reload)
# ---------- py_2: Python ----------
if reload:
    from compas_ghpython import unload_modules
    unload_modules('compas')
    unload_modules('workshop_sjsu')
    unload_modules('compas_fab')
# ---------- end py_2 ----------

# ----
# 3. Define boundary circle
# (increase or decrease radius until it fits)
# Boundary
# Change radius to fit the curve into the circle
number_slider = Slider(19, range=0..100)
xy = XYPlane(Origin=Point(0, 0, 0))
cir = Circle(Plane=xy, Radius=number_slider)
circle = Circle(cir)

# ----
# Parameters
panel_5 = Panel("polyline curve")
count = Slider(20, range=0..100)
increment = Slider(0.03, range=0.001..0.3)
radius = Slider(1, range=0..10)
split_length = Slider(2, range=0..10)
curve = Curve(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)

# ----
# Note: Don't save the file into a different folder
name = Data(panel_4)

# ---- group: TOGGLE TO RUN SIMULATION
run = Button()

# ----
# Differential growth
explode = Explode(Curve=curve, Recursive=True)  # -> Segments, Vertices
run_2 = Data(run)
count_2 = Number(count)
loop_start = LoopStart(Data=explode.Segments, Count=count_2, Trigger=run_2)  # -> port, Data, Counter
python = PythonScript(Lines=loop_start.Data, splitLength=split_length)  # -> l; inputs Lines: list
# ---------- python: Python ----------
import rhinoscriptsyntax as rs

l = []

for i in range(len(Lines)):
    L=Lines[i]
    if rs.CurveLength(L)> splitLength:
        l.append(rs.AddLine(rs.CurveStartPoint(L),rs.CurveMidPoint(L)))
        l.append(rs.AddLine(rs.CurveMidPoint(L),rs.CurveEndPoint(L)))
    else:
        l.append(L)
# ---------- end python ----------
len = Length(Curve=python)
increment_2 = Number(increment)
equals = Equality(FirstNumber=loop_start.Counter, SecondNumber=count_2)  # -> Equality, Inequality
addition = Addition(A=len, B=increment_2)
end = EndPoints(Curve=python)  # -> Start, End
length_line = LengthLine(Line=python, Length=addition, Strength=1)
sc = SphereCollide(Points=end.Start, Radius=radius, Strength=1)
bool = Boolean([True, False])
solver = Solver(GoalObjects=[sc, length_line], Reset=bool, Threshold=1e-15, Tolerance=0.01, On=equals.Inequality)  # -> I, V, O
simplify = SimplifyTree(Tree=solver.O, Front=False)
branch = TreeBranch(Tree=simplify, Path="{1}", MaintainPaths=True)
shift = ShiftList(List=branch, Shift=1, Wrap=False)
loop_end = LoopEnd(port=loop_start.port, Data=shift, state="Constant output")

# ----
# 2. Press on data dam
dam = DataDam(DataA=loop_end, BufferDelay=10000000, BufferMode=0)
end_2 = EndPoints(Curve=dam)  # -> Start, End
nurbs = NurbsCurve(Vertices=end_2.Start, Degree=3, Periodic=False)  # -> Curve, Length, Domain

# ----
# Resolution
# Define resolution of the curve, ideally not higher than 1000 points
number_slider_2 = Slider(0.6, range=0.1..20)
py_3 = GhPythonScript(C=nurbs.Curve, N=number_slider_2, circle=circle)  # -> points2d, points2d_n, crv, params
# ---------- py_3: Python ----------
import Rhino.Geometry as rg


params = rg.Curve.DivideByLength(C, N, True)
points2d = [C.PointAt(p) for p in params]

points2d_n = []
for point in points2d:
    point_new = (point + rg.Vector3d(circle.Radius, circle.Radius, 0))/(2 * circle.Radius)
    points2d_n.append(point_new)
    

crv = rg.Curve.CreateControlPointCurve(points2d)
params = [rg.Curve.ClosestPoint(crv, pt)[1] for pt in points2d]
# ---------- end py_3 ----------
pt = Point(py_3.points2d)

# ----
# Gradient
# Color
image = ImageSampler(
    py_3.points2d_n,
    FilePath="C:\Users\rustr\workspace\teaching\workshop_sjsu\images\gradient-05.png",
    Filter="Colour",
    Interpolate=False,
    Umax=1,
    Umin=0,
    Vmax=1,
    Vmin=0,
    Wrap=1)
# Create your own or look into workshop_sjsu\images for other gradients.
# ATTENTION: If you create your own, please make them the same size of 100x100 px.
image_2 = ImageSampler(
    py_3.points2d_n,
    FilePath="C:\Users\rustr\workspace\teaching\workshop_sjsu\images\gradient-02.png",
    Filter="Value",
    Interpolate=False,
    Umax=1,
    Umin=0,
    Vmax=1,
    Vmin=0,
    Wrap=1)
multiplication = Multiplication(A=image_2, B=Slider(0.05, range=0..5))
gradient = Number(image_2)
cloud = CloudDisplay(Points=py_3.points2d, Colours=image, Size=multiplication, SpriteType=0)

dam_2 = DataDam(DataA=gradient, BufferDelay=10000000, BufferMode=0)
dam_3 = DataDam(DataA=py_3.points2d, BufferDelay=10000000, BufferMode=0)

# ----
# Sphere
py_4 = GhPythonScript()  # -> sphere; unedited script template
sphere = Geometry(py_4)
preview = CustomPreview(Geometry=sphere, Material=ColourSwatch(SwatchColor=RGBA(255, 255, 255, 76)))

python_2 = GhPythonScript(sphere=sphere, circle=circle, points2d=dam_3, scale=Slider(1.34, range=0.3..2.5))  # -> P, points3d; inputs sphere: Surface, points2d: list
# ---------- python_2: Python ----------
from workshop_sjsu.rhino.utilities import map2sphere


points3d = map2sphere(sphere, circle, points2d, scale)
# ---------- end python_2 ----------

# ----
# Map curves on sphere
# change here to scale
points3d = Point(python_2.points3d)

# ----
# Export for robot
python_3 = GhPythonScript(points3d=points3d, gradients=dam_2, colors=image)  # -> data; inputs points3d: tree, gradients: tree, colors: tree
# ---------- python_3: Python ----------
from workshop_sjsu.rhino.utilities import format_data_for_export

data = format_data_for_export(points3d, gradients, colors)

data = [data]
# ---------- end python_3 ----------
python_4 = GhPythonScript(DATA=py.DATA, name=name)  # -> filepath
# ---------- python_4: Python ----------
import os

filename = name + ".json"
filepath = os.path.join(DATA, filename)
print filepath
# ---------- end python_4 ----------
to_json = ToJSON(data=python_3, filepath=python_4, pretty=Toggle(True))  # -> json; inputs pretty: Boolean
#   port data: COMPAS data objects to serialize.
#   port filepath: File path where to store the JSON file. If empty, it will not store to disk but instead return the JSON string.
#   port pretty: If True, JSON data will be formatted with indentation and key sorting.
#   port json: JSON file path or JSON string.
# ---------- to_json: Python ----------
"""
Serializes COMPAS objects to JSON.
"""
from ghpythonlib.componentbase import executingcomponent as component

import compas


class CompasInfo(component):
    def RunScript(self, data, filepath, pretty):
        json = filepath

        if filepath:
            compas.json_dump(data, filepath, pretty)
        else:
            json = compas.json_dumps(data, pretty)

        return json
# ---------- end to_json ----------

# ----
# Visualisation
number_slider_3 = Slider(0.014, range=0..0.04)
python_5 = GhPythonScript(points3d=points3d, gradients=dam_2, scale=Slider(0.008, range=0..0.01))  # -> crv, params, radii; inputs points3d: list, gradients: list
# ---------- python_5: Python ----------
import Rhino.Geometry as rg
import scriptcontext


crv = rg.Curve.CreateControlPointCurve(points3d)
params = [crv.ClosestPoint(pt)[1] for pt in points3d]
radii = [r*scale for r in gradients]
# ---------- end python_5 ----------
vpipe = PipeVariable(Curve=python_5.crv, Parameters=python_5.params, Radii=python_5.radii, Caps=0)  # -> flatten(Pipe)
multiplication_2 = Multiplication(A=image_2, B=number_slider_3)
colour_swatch = ColourSwatch(SwatchColor=RGB(0, 255, 123))
cloud_2 = CloudDisplay(Points=points3d, Colours=image, Size=multiplication_2, SpriteType=0)
preview_2 = CustomPreview(Geometry=vpipe, Material=colour_swatch)

for_mac = Panel("http://localhost:8080/USER/workshops/workshop_sjsu/web/example01.html")

# ----
# Export for view
# This takes some time ...
# 4. Press data dam to convert to mesh and export for html viewer
dam_4 = DataDam(DataA=vpipe, BufferDelay=10000000, BufferMode=0)
mesh = MeshBrep(
    Brep=dam_4,
    Settings={GridMaxCount=0, GridMinCount=16, JaggedSeams=False, MaxEdgeLength=0, MinEdgeLength=0.0001, MinTolerance=0, Refine=True, RefineAngle=0, RelativeTolerance=0.65, SimplePlanes=True, Tolerance=0})

py_5 = GhPythonScript(M=mesh)  # -> meshes; inputs M: list
# ---------- py_5: Python ----------
from workshop_sjsu.glb_viewer import transform_and_process_meshes_for_glb

meshes = transform_and_process_meshes_for_glb(M)
# ---------- end py_5 ----------

python_6 = GhPythonScript(meshes=py_5, name=name, color=colour_swatch, write=Button())  # -> out; inputs meshes: list
# ---------- python_6: Python ----------
from workshop_sjsu.glb_viewer import create_glb_viewer
from compas.utilities import color_to_rgb

color = color_to_rgb([color.R, color.G, color.B], normalize=True)

if write:
    create_glb_viewer(name, meshes, color)
# ---------- end python_6 ----------
# Run
# 
# workshop_sjsu/web/http-file-server.exe
# 
#  and open
# 
# http://localhost:8080/web/example01.html
# 
# in your browser
panel_6 = Panel(python_6)
