# Grasshopper definition example06.ghx (Grasshopper 1.0.7)
# plug-ins: Kangaroo2 Components, Anemone

# ----
# Boundary
# Change radius to fit the curve into the circle
number_slider = Slider(19, range=0..100)
xy = XYPlane(Origin=Point(0, 0, 0))
cir = Circle(Plane=xy, Radius=number_slider)
circle = Circle(cir)

reload = Button()
py = GhPythonScript()  # -> WEB, DATA
# ---------- py: Python ----------
import sys
import os

filepath = os.path.dirname(ghenv.Component.OnPingDocument().FilePath)

LIB = os.path.join(filepath, "..", "src")
LIB = os.path.abspath(LIB)

sys.path.append(LIB)

from workshop_sjsu import DATA
from workshop_sjsu import WEB
# ---------- end py ----------
panel = Panel("1.a) Define planar curve/s")
panel_2 = Panel("1.b) Run simulation")
panel_3 = Panel("Example 01: Differential growth")
run = Button()
python = GhPythonScript(num=Slider(7, range=0..10), diff=Slider(3, range=0..10), size=Slider(45, range=0..100))  # -> out, L, a; inputs num: Int32
# ---------- python: Python ----------
import Rhino.Geometry as rg


L = []

for i in range(num):
    
    p1 = rg.Point3d(i*diff,0,0)
    p2 = rg.Point3d(-i*diff,0,0)
    v = rg.Vector3d(0, size/2., 0)
    L.append(rg.Line(p1 + v, p1 - v))
    L.append(rg.Line(p2 + v, p2 - v))
# ---------- end python ----------
py_2 = PythonScript(reload=reload)
# ---------- py_2: Python ----------
if reload:
    from compas_ghpython import unload_modules
    unload_modules('compas')
    unload_modules('workshop_sjsu')
    unload_modules('compas_fab')
# ---------- end py_2 ----------

# ----
# Parameters
panel_4 = Panel("polyline curve")
count = Slider(20, range=0..100)
# 3. Define boundary circle
# (increase or decrease radius until it fits)
increment = Slider(0.03, range=0.001..0.3)
radius = Slider(1, range=0..10)
split_length = Slider(2, range=0..10)
curve = Curve(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)

name = Data("example02")

# ----
# Differential growth
run_2 = Data(run)
count_2 = Number(count)
explode = Explode(Curve=python.L, Recursive=True)  # -> Segments, Vertices
loop_start = LoopStart(Data=explode.Segments, Count=count_2, Trigger=run_2)  # -> port, Data, Counter
python_2 = PythonScript(Lines=loop_start.Data, splitLength=split_length)  # -> l; inputs Lines: list
# ---------- python_2: Python ----------
import rhinoscriptsyntax as rs

l = []

for i in range(len(Lines)):
    L=Lines[i]
    if rs.CurveLength(L)> splitLength:
        l.append(rs.AddLine(rs.CurveStartPoint(L),rs.CurveMidPoint(L)))
        l.append(rs.AddLine(rs.CurveMidPoint(L),rs.CurveEndPoint(L)))
    else:
        l.append(L)
# ---------- end python_2 ----------
len = Length(Curve=python_2)
increment_2 = Number(increment)
end = EndPoints(Curve=python_2)  # -> Start, End
addition = Addition(A=len, B=increment_2)
equals = Equality(FirstNumber=loop_start.Counter, SecondNumber=count_2)  # -> Equality, Inequality
length_line = LengthLine(Line=python_2, Length=addition, Strength=1)
sc = SphereCollide(Points=end.Start, Radius=radius, Strength=1)
bool = Boolean([True, False])
solver = Solver(GoalObjects=[sc, length_line], Reset=bool, Threshold=1e-15, Tolerance=0.01, On=equals.Inequality)  # -> I, V, O
simplify = SimplifyTree(Tree=solver.O, Front=False)
branch = TreeBranch(Tree=simplify, Path="{1}", MaintainPaths=True)
shift = ShiftList(List=branch, Shift=1, Wrap=False)
loop_end = LoopEnd(port=loop_start.port, Data=shift, state="Constant output")

# ---- group: TOGGLE TO RUN SIMULATION
run_3 = Button()

# ----
python_3 = GhPythonScript(crv=python.L, y=Slider(2, range=0..10))  # -> out, P, segments; inputs crv: Curve
# ---------- python_3: Python ----------
import Rhino.Geometry as rg


params = rg.Curve.DivideByLength(crv, y, True)
P = [crv.PointAt(t) for t in params]

segments = []
for t0, t1 in zip(params[:-1], params[1:]):
    segments.append(rg.Curve.Trim(crv, t0, t1))
print segments
# ---------- end python_3 ----------
loop_start_2 = LoopStart(Data=python_3.segments, Count=count_2, Trigger=run_2)  # -> port, Data, Counter

# ----
# Differential growth
explode_2 = Explode(Curve=curve, Recursive=True)  # -> Segments, Vertices
run_4 = Data(run_3)
count_3 = Number(count)
loop_start_3 = LoopStart(Data=explode_2.Segments, Count=count_3, Trigger=run_4)  # -> port, Data, Counter
python_4 = PythonScript(Lines=loop_start_3.Data, splitLength=split_length)  # -> l; inputs Lines: list; same code as python_2
len_2 = Length(Curve=python_4)
increment_3 = Number(increment)
equals_2 = Equality(FirstNumber=loop_start_3.Counter, SecondNumber=count_3)  # -> Equality, Inequality
addition_2 = Addition(A=len_2, B=increment_3)
end_2 = EndPoints(Curve=python_4)  # -> Start, End
length_line_2 = LengthLine(Line=python_4, Length=addition_2, Strength=1)
sc_2 = SphereCollide(Points=end_2.Start, Radius=radius, Strength=1)
bool_2 = Boolean([True, False])
solver_2 = Solver(GoalObjects=[sc_2, length_line_2], Reset=bool_2, Threshold=1e-15, Tolerance=0.01, On=equals_2.Inequality)  # -> I, V, O
simplify_2 = SimplifyTree(Tree=solver_2.O, Front=False)
branch_2 = TreeBranch(Tree=simplify_2, Path="{1}", MaintainPaths=True)
shift_2 = ShiftList(List=branch_2, Shift=1, Wrap=False)
loop_end_2 = LoopEnd(port=loop_start_3.port, Data=shift_2, state="Constant output")

equals_3 = Equality(FirstNumber=loop_start_2.Counter, SecondNumber=count_2)  # -> Equality, Inequality
end_3 = EndPoints(Curve=loop_start_2.Data)  # -> Start, End
len_3 = Length(Curve=loop_start_2.Data)
increment_4 = Number(increment)
addition_3 = Addition(A=len_3, B=increment_4)
sc_3 = SphereCollide(Points=end_3.Start, Radius=radius, Strength=1)
length_line_3 = LengthLine(Line=python_3.segments, Length=addition_3, Strength=1)
bool_3 = Boolean([True, False])
solver_3 = Solver(GoalObjects=[sc_3, length_line_3], Reset=bool_3, Threshold=1e-15, Tolerance=0.01, On=equals_3.Inequality)  # -> I, V, O
simplify_3 = SimplifyTree(Tree=solver_3.O, Front=False)
branch_3 = TreeBranch(Tree=simplify_3, Path="{1}", MaintainPaths=True)
shift_3 = ShiftList(List=branch_3, Shift=1, Wrap=False)
loop_end_3 = LoopEnd(port=loop_start.port, Data=shift_3, state="Constant output")
