# Grasshopper definition example07_attractor.ghx (Grasshopper 1.0.7)

number_slider = Slider(0.1, range=0..0.1)
number_slider_2 = Slider(0.1, range=0..0.1)
pt = Point([<point referenced from the Rhino model> x3])
number_slider_3 = Slider(0.1, range=0..0.1)
python = GhPythonScript(attrPt=pt, scale=Slider(0.05, range=0..0.1), rangex=Slider(5, range=0..10))  # -> out, C, L, a; inputs attrPt: list
# ---------- python: Python ----------
import Rhino.Geometry as rg

P = []

for i in range(10):
    for j in range(10):
        P.append(rg.Point3d(i,j,0))

 
C = []
L = []

for p in P:
    
    distance = 0
    vector = rg.Vector3d(0,0,0)
    for a in attrPt:
        d = p.DistanceTo(a)
        if d < rangex: 
            distance += d
            v = (p - a)
            vector += v
    c = rg.Circle(rg.Plane(p, rg.Vector3d.XAxis, rg.Vector3d.YAxis), distance/20)
    C.append(c)
    L.append(rg.Line(p - vector * scale, p + vector * scale))
# ---------- end python ----------
pt_2 = Point([<point referenced from the Rhino model> x3])
crv = Curve(python.L)
python_2 = GhPythonScript(
    xdim=Slider(20, range=0..100),
    ydim=Slider(20, range=0..100),
    step=Slider(0.4, range=0..1),
    attrPt=pt_2,
    scale=Slider(0.05, range=0..1),
    rangex=Slider(4, range=0..10))  # -> out, C, L, curves, a; inputs xdim: Int32, ydim: Int32, attrPt: list
# ---------- python_2: Python ----------
import Rhino.Geometry as rg

points2d = []

for i in range(xdim):
    pts = []
    for j in range(ydim):
        pts.append(rg.Point3d(i * step,j * step,0))
    points2d.append(pts)

 
C = []
L = []

curves = []

for pts in points2d:
    
    cpts = []
    for p in pts:
        distance = 0
        vector = rg.Vector3d(0,0,0)
        for a in attrPt:
            d = p.DistanceTo(a)
            if d < rangex: 
                distance += d
                v = (p - a)
                vector += v
        c = rg.Circle(rg.Plane(p, rg.Vector3d.XAxis, rg.Vector3d.YAxis), distance/20)
        C.append(c)
        L.append(rg.Line(p - vector * scale, p + vector * scale))
        cpts.append(p + vector * scale * 2)
    curves.append(rg.Curve.CreateControlPointCurve(cpts))
# ---------- end python_2 ----------
geo = Geometry(python.C)
crv_2 = Curve([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])
geo_2 = Geometry(python_2.C)
data = Data(python_2.curves)
crv_3 = Curve(python_2.L)  # disabled
